# Dynamo graph rpw.dyn (Dynamo 2.0.3.8810)

RPW_GetFilepath = Custom[RPW_GetFilepath]()
python_script = Python(IN[0]=RPW_GetFilepath)
# ---------- python_script.python (18 lines) ----------
import sys
sys.path.append(IN[0])

from rpw.db import Element
from rpw.db import Collector


all_col = Collector(of_category='Walls', is_not_type=True)
col = Collector(of_category='Walls', level = "レベル 1")

all_wall = all_col.elements
wall = col.elements
#param_name = wall.parameters.builtins['WALL_BOTTOM_IS_ATTACHED'].name
#param_value = wall.parameters.builtins['WALL_BOTTOM_IS_ATTACHED'].value



OUT = [all_wall, wall]
# ----------------------------------------
get_levels = Watch(python_script)
boolean = BoolSelector(true)  # graph input
code_block = CodeBlock { ["level1","level2","level3"]; }
python_script_2 = Python(IN[0]=RPW_GetFilepath, IN[1]=boolean, IN[2]=code_block)
# ---------- python_script_2.python (9 lines) ----------
import sys
sys.path.append(IN[0])

from rpw.ui import forms

if IN[1]:
	options = IN[2]
	selected = forms.SelectFromList('Test', options)
	OUT = selected
# ----------------------------------------
result = Watch(python_script_2)
number_slider = DoubleSlider(0, range=0..100 step 0.1)  # graph input
transaction = Python(IN[0]=RPW_GetFilepath, IN[1]=number_slider)
# ---------- transaction.python (9 lines) ----------
import sys
sys.path.append(IN[0])

import rpw

level = rpw.db.Collector(of_category='OST_Levels', is_not_type=True).first

with rpw.db.Transaction('Add Comment'):
	level.Elevation = IN[1]
# ----------------------------------------
python_script_3 = Python(IN[0]=RPW_GetFilepath, IN[1]=boolean)
# ---------- python_script_3.python (8 lines) ----------
import sys
sys.path.append(IN[0])

if IN[1]:
	from rpw.ui.forms import TextInput
	value = TextInput('Title', default="3")

OUT = value
# ----------------------------------------
result_2 = Watch(python_script_3)
boolean_2 = BoolSelector(false)  # graph input
python_script_4 = Python(IN[0]=RPW_GetFilepath, IN[1]=boolean_2)
# ---------- python_script_4.python (9 lines) ----------
import sys
sys.path.append(IN[0])


from rpw.ui.forms import Alert


if IN[1]:
	Alert('ちょっと変わった建築学生', title="エラー", header="コロナに負けるな")
# ----------------------------------------
boolean_3 = BoolSelector(true)  # graph input
code_block_2 = CodeBlock { ["level1","level2","level3"]; }
python_script_5 = Python(IN[0]=RPW_GetFilepath, IN[1]=boolean_3, IN[2]=code_block_2)
# ---------- python_script_5.python (22 lines) ----------
import sys
sys.path.append(IN[0])


from rpw.ui.forms import (FlexForm, Label,TextBox,ComboBox,                                   					      TextBox,Separator, Button, CheckBox)
                           
                           
                         
components = [Label('level:'),
              ComboBox("Text", IN[2]),
              Label('level high:'),
              TextBox('textbox1', Text="Default Value"),
              Label('true/false:'),
              CheckBox('checkbox1', 'Check this'),
              Separator(),
              Button('Select')]

form = FlexForm('Title', components)
if IN[1]:
	form.show()

OUT = str(form.values)
# ----------------------------------------
result_3 = Watch(python_script_5)
