# Dynamo graph テキストから共有パラメーター.dyn "実験" (Dynamo 2.0.3.8810)

file_path = Filename("..\excel\共有パラメーター.xlsx")
file_from_path = FileObject(path=file_path)
code_block = CodeBlock { "Sheet1"; }
importExcel = Data.ImportExcel(file=file_from_path, sheetName=code_block)
code_block_2 = CodeBlock { 0; }
removeItemAtIndex = List.RemoveItemAtIndex(list=importExcel, indices=code_block_2)
transpose = List.Transpose(lists=removeItemAtIndex)
code_block_3 = CodeBlock(x=transpose) { x[1]; }
byName = Category.ByName(name=code_block_3)
file_path_2 = Filename("..\..\..\..\ProgramData\Autodesk\RVT 2019\Libraries\Generic\example.txt")
sharedparameters_from_txt_file = Custom[SharedParameters from txt file](FilePath=file_path_2)  # Gets parameters from SharedParameter .txt file
code_block_4 = CodeBlock(x=sharedparameters_from_txt_file.Revit_Parameters) { x; }
code_block_5 = CodeBlock(x=transpose) { x[0]; }
code_block_6 = CodeBlock(x=sharedparameters_from_txt_file.Parameter_Names) { x; }
python_script = Python(IN[0]=code_block_5, IN[1]=code_block_6)
# ---------- python_script.python (23 lines) ----------
# Python のサポートを有効にして DesignScript ライブラリをロード
import clr
clr.AddReference('ProtoGeometry')
from Autodesk.DesignScript.Geometry import *

# このノードへの入力は、リスト形式で IN 変数に格納されます。
collect_num = IN[0]
worng_num = IN[1]
w = []
q = []
# この行の下にコードを配置します
for x in collect_num:
	for y in worng_num:
		if x == y:
			w.append(1)	
			q.append(sum(w)-1)
			w = []
			break
			
		else:
			w.append(1)
# 出力を OUT 変数に割り当てます。
OUT = q
# ----------------------------------------
sortByKey = List.SortByKey(list=code_block_4, keys=python_script)
parameter_groups = ParameterGroupUi(index=105)
code_block_7 = CodeBlock { 10; }
ofRepeatedItem = List.OfRepeatedItem(item=parameter_groups, amount=code_block_7)
code_block_8 = CodeBlock(x=transpose) { x[3]; }
python_script_2 = Python(IN[0]=code_block_8)
# ---------- python_script_2.python (18 lines) ----------
# Python のサポートを有効にして DesignScript ライブラリをロード
import clr
clr.AddReference('ProtoGeometry')
from Autodesk.DesignScript.Geometry import *

# このノードへの入力は、リスト形式で IN 変数に格納されます。
str = IN[0]
a = []
b = []
# この行の下にコードを配置します
for x in str:
	b.append(x)
	if "instance" in x:
		a.append(True)
	else:
		a.append(False)
# 出力を OUT 変数に割り当てます。
OUT = a
# ----------------------------------------
add_shared_parameter_s_from_txt = Custom[Add Shared Parameter(s) from txt](Category_var=byName, Parameters_s_var=sortByKey.sorted_list, ParameterGroup=ofRepeatedItem, Is_Instance_Parameter_var=python_script_2, lacing=Shortest)  # Add shared parameters to project from SharedParameter .txt file
